# Dynamo graph voxelMaker-90-pipe.dyn (Dynamo 0.9.0.3067)

setup = StringInput("""
$ test Nastrynamo - Dyn to Nas writer

SOL 101
CEND
ECHO = NONE
TITLE = 
DISPLACEMENT(PLOT) = ALL
FORCE(PLOT,CORNER) = ALL
VOLUME 1, SET ALL, SYSTEM BASIC
SUBCASE 1
   SPC  = 1
   LOAD = 1
   STRAIN(PLOT,CORNER) = ALL
   STRESS(PLOT,CORNER) = ALL
   GPFORCE(PLOT) = ALL
   OLOAD(PLOT,REAL,RALL) = ALL
BEGIN BULK  


""")
SIZE = CodeBlock { 10; }
code_block = CodeBlock(n=SIZE) { n-1; n; }
code_block_2 = CodeBlock(X=code_block.out0, Nx=code_block.n, Y=code_block.out0, Ny=code_block.n, Z=code_block.out0, Nz=code_block.n) { 0..(X)..#Nx; 0..(Y)..#Ny; 0..(Z)..#Nz; }
byCoordinates = Point.ByCoordinates(x=code_block_2.out0, y=code_block_2.out1, z=code_block_2.out2, lacing=CrossProduct)
code_block_3 = CodeBlock(point1=byCoordinates)
# ---------- code_block_3.designscript (6 lines) ----------
t2 = Flatten(point1);
point2 = Autodesk.Point.Origin();
vector1 = Vector.YAxis();
geometry1 = t2.Rotate(point2, vector1, 90);
plane1 = Plane.XY();
geometry2 = geometry1.Mirror(plane1);
# ----------------------------------------
points = CodeBlock(p=code_block_3.geometry2) { p; }
size_grid = Watch(code_block.n)
code_block_4 = CodeBlock(x=points, w=size_grid) { x[0]; c = Count(x); x[c-1]; x[w-1]; x[c-w]; w/10; }
byStartPointEndPoint = Line.ByStartPointEndPoint(startPoint=code_block_4.out0, endPoint=code_block_4.out2)
point_near_line = Python(IN[0]=points, IN[1]=byStartPointEndPoint, IN[2]=code_block_4.out5)
# ---------- point_near_line.python (74 lines) ----------
import clr
import sys
sys.path.append('C:\Program Files (x86)\IronPython 2.7\Lib')

clr.AddReference('ProtoGeometry')
from Autodesk.DesignScript.Geometry import *
#The inputs to this node will be stored as a list in the IN variables.
dataEnteringNode = IN
import math

def dot(v,w):
    x,y,z = v
    X,Y,Z = w
    return x*X + y*Y + z*Z
  
def length(v):
    x,y,z = v
    return math.sqrt(x*x + y*y + z*z)
  
def vector(b,e):
    x,y,z = b
    X,Y,Z = e
    return (X-x, Y-y, Z-z)
  
def unit(v):
    x,y,z = v
    mag = length(v)
    return (x/mag, y/mag, z/mag)
  
def distance(p0,p1):
    return length(vector(p0,p1))
  
def scale(v,sc):
    x,y,z = v
    return (x * sc, y * sc, z * sc)
  
def add(v,w):
    x,y,z = v
    X,Y,Z = w
    return (x+X, y+Y, z+Z)

def pnt2line(pnt, l):
	
	start = (l.StartPoint.X, l.StartPoint.Y, l.StartPoint.Z)
	end = (l.EndPoint.X, l.EndPoint.Y, l.EndPoint.Z)
	line_vec = vector((start),(end))
	pnt_vec = vector(start, pnt)
	line_len = length(line_vec)
	line_unitvec = unit(line_vec)
	pnt_vec_scaled = scale(pnt_vec, 1.0/line_len)
	t = dot(line_unitvec, pnt_vec_scaled)    
	if t < 0.0:
		t = 0.0
	elif t > 1.0:
		t = 1.0
	nearest = scale(line_vec, t)
	dist = distance(nearest, pnt_vec)
	nearest = add(nearest, start)
	return (dist) #, nearest)

point_in = IN[0]
ln = IN[1]
seek = IN[2]

#OUT = pnt2line((1,2,3),(0,0,0),(10,10,10)  )

near_list = [] 

for i, pt in enumerate(point_in):
	pt_in = (pt.X,pt.Y,pt.Z)
	if pnt2line(pt_in,ln ) < seek:
		near_list.append(i)

OUT = near_list
# ----------------------------------------
python_script = Python(IN[0]=point_near_line, IN[1]=size_grid)
# ---------- python_script.python (18 lines) ----------
import clr
clr.AddReference('ProtoGeometry')
from Autodesk.DesignScript.Geometry import *
#The inputs to this node will be stored as a list in the IN variables.
dataEnteringNode = IN

i = IN[0]
w = IN[1]

list = []
for x in i:
	if x % w == w-1 or ((x-x % w)/w)%w == w-1 or x == 0:
		b = 0
	else:
		list.append(x)

#Assign your output to the OUT variable.
OUT = list
# ----------------------------------------
py_index_to_ibrick = Python(IN[0]=python_script, IN[1]=size_grid)
# ---------- py_index_to_ibrick.python (46 lines) ----------
import clr
import sys
sys.path.append('C:\Program Files (x86)\IronPython 2.7\Lib')
import math
import operator
clr.AddReference('ProtoGeometry')
from Autodesk.DesignScript.Geometry import *

points = IN[0]
w = IN[1]

grid = []
outCoord = []

def iBrick(ind):

	outputCHEXA = "$chexa \n\n"
	
	count = 1
	for count,i in enumerate(ind):
		#(x + y*w + z*w**2)

		c1 = int(i) 
		c4 = int(i + 1)
		c2 = int(i + w )  
		c3 = int(i + w + 1)
		
		c5 = int(i + w*w ) 
		c8 = int(i + w*w + 1) 
		c6 = int(i + w*w + w ) 
		c7 = int(i + w*w + w + 1) 
		
		outputB = "CHEXA   {:<8}1       {:<8}{:<8}{:<8}{:<8}{:<8}{:<8} \n        {:<8}{:<8}\n\n".format(i, (c5),(c6),(c7),(c8),(c1),(c2),(c3),(c4))
		
		unit = [(c5),(c6),(c7),(c8),(c1),(c2),(c3),(c4)]
		grid.append(unit)
		
		outputCHEXA = outputCHEXA + outputB
		
	return outputCHEXA, grid
	
	


	
OUT = iBrick(points)
# ----------------------------------------
code_block_5 = CodeBlock(x=py_index_to_ibrick) { x[1]; x[0]; }
watch = Watch(code_block_5.out1)
gravity = StringInput("""                                                                                                                
GRAV    99998           9814.56 0.      16.     -1.    
""")
string = StringInput("\n$Force\n")
force = Watch(string)
code_block_6 = CodeBlock(x=code_block_5.out0) { List.Sort( List.UniqueItems(Flatten(x))); }
py_grid_to_index = Python(IN[0]=code_block_6, IN[1]=size_grid)
# ---------- py_grid_to_index.python (68 lines) ----------
import clr
import math
import sys
sys.path.append('C:\Program Files (x86)\IronPython 2.7\Lib')
import operator
from sets import Set
from multiprocessing import Pool
clr.AddReference('ProtoGeometry')
from Autodesk.DesignScript.Geometry import *
	
points = IN[0]
w = int(IN[1])


def base36encode(number, alphabet='0123456789ABCDEFGHIJKLMNOPQRSTUVWXY'):
    if not isinstance(number, (int, long)):
        raise TypeError('number must be an integer')
    base36 = ''
    sign = ''
    if number < 0:
        sign = '-'
        number = -number
    if 0 <= number < len(alphabet):
        return sign + alphabet[number]
    while number != 0:
        number, i = divmod(number, len(alphabet))
        base36 = alphabet[i] + base36
    return sign + base36
	
def i2g_s(ind):

	z = float((ind // w**2))
	y = float((ind// w)-w*z)
	x = float(ind % w)


	return [x,y,z]

#def g2i_s(ind):
#	outInd = []
#	z = ind[2]
#	y = ind[1]
#	x = ind[0]
#	outInd = int(x + y*w + z*w**2)
#	return outInd
	
index = []
strG = "GRID*   "
strG1 = "0               "
outputGRID = "\n"
outputG = []

i=1
for b in points:

	x2 = i2g_s(b)[0] 
	y2 = i2g_s(b)[1] 
	z2 = i2g_s(b)[2] 
	
	coord = [x2, y2, z2, i]
	outputG.append(coord)
#	outputT = "{}{:<8}{:<8}{:<8}{:<8} \n".format(strG, g2i_s([x2,y2,z2]), x2 , y2 , z2 )			
	outputT = "{}{:<16}{}{:<16}{:<16}*{:<6}\n*{:<7}{:<16} \n".format(strG, int(b), strG1, x2 , y2 , base36encode(i-1),base36encode(i-1), z2 )
	outputGRID = outputGRID + outputT
	
	i += 1 
	
OUT = outputGRID
# ----------------------------------------
watch_2 = Watch(py_grid_to_index)
loading = StringInput("""
$Static Load Combination (Superposition)                                        
LOAD    1       1.      1.      10000   1.      10001   1.      99999           
        1.      99998   0.      99994   0.      99993      
""")
materials = StringInput("""
$Isotropic Material Property Definition                                         
$Material for Part 1 - Quenched and tempered                                    
MAT1    1       199948.         0.29    7.8547-91.17-5  0.                      
$Heat Transfer Material Properties, Isotropic                                   
$Material for Part 1 - Quenched and tempered                                    
MAT4    1       0.0467590. 
""")
parameters = StringInput("""PARAM,POST,-1
PARAM,OGEOM,NO
PARAM,AUTOSPC,YES
PARAM,GRDPNT,0
$In SimMech, results are in element coordinates (except solids; see VOLUME).    
PARAM,ELEMRSLTCORD,ELEMENT
PARAM,ELEMGEOMCHECKS,OFF



$Properties of Solid Elements                                                   
PSOLID  1       1       0                                                       



""")
code_block_7 = CodeBlock { 0.5; }
py_spc = Python(IN[0]=code_block_6, IN[1]=size_grid, IN[2]=code_block_7)
# ---------- py_spc.python (36 lines) ----------
import clr
import operator
clr.AddReference('ProtoGeometry')
from Autodesk.DesignScript.Geometry import *
#The inputs to this node will be stored as a list in the IN variables.
dataEnteringNode = IN

grid = IN[0]
w = IN[1]
fp = IN[2]

newSPC = ''
strF = "SPC     1       "  
strF1 = "123"
spcList = "\n\n"

list1 = []
	
def i2g_s(itg):

	z = operator.floordiv(itg, w**2) 
	y = operator.floordiv(itg, w)-w*z
	x = itg % w

	return [x,y,z]
	
	
for i, p in enumerate(grid):
	if i2g_s(p)[2] < fp:
		
		list1.append(p)
		newSPC =  "{}{:<8}{} \n".format(strF,str(p),strF1)
		spcList = spcList + newSPC

#Assign your output to the OUT variable.
OUT = spcList
# ----------------------------------------
watch_3 = Watch(py_spc)
constraints = Watch(watch_3)
end_data = StringInput("""                                                  
                                          
TEMPD   3       0.                                                              
ENDDATA

""")
concat = String.Concat(setup, watch, gravity, force, watch_2, loading, materials, parameters, constraints, end_data)
NAS_output = Watch(concat)
string_2 = StringInput("C:\test\Nastrynamo\Voxels\NasWrite\voxel_maker-p3.nas")
writeText = File.WriteText(string_2, concat)
code_block_8 = CodeBlock { Flatten({103,104,113,114,203,204,213,214}); }
code_block_9 = CodeBlock(x=code_block_8)
# ---------- code_block_9.designscript (3 lines) ----------
x[0];
//t2 = List.GetItemAtIndex(t3, t4);
//sphere1 = Autodesk.Sphere.ByCenterPointRadius(t2, 0.0625);
# ----------------------------------------
point_2_line = Python()
# ---------- point_2_line.python (64 lines) ----------
import clr
import sys
sys.path.append('C:\Program Files (x86)\IronPython 2.7\Lib')

clr.AddReference('ProtoGeometry')
from Autodesk.DesignScript.Geometry import *
#The inputs to this node will be stored as a list in the IN variables.
dataEnteringNode = IN
import math

def dot(v,w):
    x,y,z = v
    X,Y,Z = w
    return x*X + y*Y + z*Z
  
def length(v):
    x,y,z = v
    return math.sqrt(x*x + y*y + z*z)
  
def vector(b,e):
    x,y,z = b
    X,Y,Z = e
    return (X-x, Y-y, Z-z)
  
def unit(v):
    x,y,z = v
    mag = length(v)
    return (x/mag, y/mag, z/mag)
  
def distance(p0,p1):
    return length(vector(p0,p1))
  
def scale(v,sc):
    x,y,z = v
    return (x * sc, y * sc, z * sc)
  
def add(v,w):
    x,y,z = v
    X,Y,Z = w
    return (x+X, y+Y, z+Z)

def pnt2line(pnt, start, end):
    line_vec = vector(start, end)
    pnt_vec = vector(start, pnt)
    line_len = length(line_vec)
    line_unitvec = unit(line_vec)
    pnt_vec_scaled = scale(pnt_vec, 1.0/line_len)
    t = dot(line_unitvec, pnt_vec_scaled)    
    if t < 0.0:
        t = 0.0
    elif t > 1.0:
        t = 1.0
    nearest = scale(line_vec, t)
    dist = distance(nearest, pnt_vec)
    nearest = add(nearest, start)
    return (dist, nearest)


#start (1, 0, 2) end (4.5, 0, 0.5)
#pnt (2, 0, 0.5)


#Assign your output to the OUT variable.
OUT = pnt2line((1,2,3),(0,0,0),(10,10,10)  )
# ----------------------------------------
watch_4 = Watch(point_2_line)
watch_5 = Watch(point_near_line)
byStartPointEndPoint_2 = Line.ByStartPointEndPoint(startPoint=code_block_4.out3, endPoint=code_block_4.out4)
