# Dynamo graph voxelMaker-90-s9b.dyn (Dynamo 0.9.0.3067)

setup = StringInput("""
$ test Nastrynamo - Dyn to Nas writer

SOL 101
CEND
ECHO = NONE
TITLE = 
DISPLACEMENT(PLOT) = ALL
FORCE(PLOT,CORNER) = ALL
VOLUME 1, SET ALL, SYSTEM BASIC
SUBCASE 1
   SPC  = 1
   LOAD = 1
   STRAIN(PLOT,CORNER) = ALL
   STRESS(PLOT,CORNER) = ALL
   GPFORCE(PLOT) = ALL
   OLOAD(PLOT,REAL,RALL) = ALL
BEGIN BULK  


""")
string = StringInput("C:\test\Nastrynamo\Voxels\mesh\bunny-30.csv")
importFromCSV = ImportFromCSV(string)
flatten = Flatten(importFromCSV)
python_script = Python(IN[0]=flatten)
# ---------- python_script.python (16 lines) ----------
import clr
clr.AddReference('ProtoGeometry')
from Autodesk.DesignScript.Geometry import *
#The inputs to this node will be stored as a list in the IN variables.
dataEnteringNode = IN

bool = IN[0]
inc = []


for c, i in enumerate(bool):
	if int(i) == 1:
		inc.append(c)

#Assign your output to the OUT variable.
OUT = inc
# ----------------------------------------
SIZE = CodeBlock { 30; }
size_grid = Watch(SIZE)
python_script_2 = Python(IN[0]=python_script, IN[1]=size_grid)
# ---------- python_script_2.python (18 lines) ----------
import clr
clr.AddReference('ProtoGeometry')
from Autodesk.DesignScript.Geometry import *
#The inputs to this node will be stored as a list in the IN variables.
dataEnteringNode = IN

i = IN[0]
w = IN[1]

list = []
for x in i:
	if x % w == w-1 or ((x-x % w)/w)%w == w-1 or x == 0:
		b = 0
	else:
		list.append(x)

#Assign your output to the OUT variable.
OUT = list
# ----------------------------------------
py_index_to_ibrick = Python(IN[0]=python_script_2, IN[1]=size_grid)
# ---------- py_index_to_ibrick.python (46 lines) ----------
import clr
import sys
sys.path.append('C:\Program Files (x86)\IronPython 2.7\Lib')
import math
import operator
clr.AddReference('ProtoGeometry')
from Autodesk.DesignScript.Geometry import *

points = IN[0]
w = IN[1]

grid = []
outCoord = []

def iBrick(ind):

	outputCHEXA = "$chexa \n\n"
	
	count = 1
	for count,i in enumerate(ind):
		#(x + y*w + z*w**2)

		c1 = int(i) 
		c4 = int(i + 1)
		c2 = int(i + w )  
		c3 = int(i + w + 1)
		
		c5 = int(i + w*w ) 
		c8 = int(i + w*w + 1) 
		c6 = int(i + w*w + w ) 
		c7 = int(i + w*w + w + 1) 
		
		outputB = "CHEXA   {:<8}1       {:<8}{:<8}{:<8}{:<8}{:<8}{:<8} \n        {:<8}{:<8}\n\n".format(i, (c5),(c6),(c7),(c8),(c1),(c2),(c3),(c4))
		
		unit = [(c5),(c6),(c7),(c8),(c1),(c2),(c3),(c4)]
		grid.append(unit)
		
		outputCHEXA = outputCHEXA + outputB
		
	return outputCHEXA, grid
	
	


	
OUT = iBrick(points)
# ----------------------------------------
code_block = CodeBlock(x=py_index_to_ibrick) { x[1]; x[0]; }
watch = Watch(code_block.out1)
gravity = StringInput("""                                                                                                                
GRAV    99998           9814.56 0.      16.     -1.    
""")
string_2 = StringInput("\n$Force\n")
force = Watch(string_2)
code_block_2 = CodeBlock(x=code_block.out0) { List.Sort( List.UniqueItems(Flatten(x))); }
py_grid_to_index = Python(IN[0]=code_block_2, IN[1]=size_grid)
# ---------- py_grid_to_index.python (68 lines) ----------
import clr
import math
import sys
sys.path.append('C:\Program Files (x86)\IronPython 2.7\Lib')
import operator
from sets import Set
from multiprocessing import Pool
clr.AddReference('ProtoGeometry')
from Autodesk.DesignScript.Geometry import *
	
points = IN[0]
w = int(IN[1])


def base36encode(number, alphabet='0123456789ABCDEFGHIJKLMNOPQRSTUVWXY'):
    if not isinstance(number, (int, long)):
        raise TypeError('number must be an integer')
    base36 = ''
    sign = ''
    if number < 0:
        sign = '-'
        number = -number
    if 0 <= number < len(alphabet):
        return sign + alphabet[number]
    while number != 0:
        number, i = divmod(number, len(alphabet))
        base36 = alphabet[i] + base36
    return sign + base36
	
def i2g_s(ind):

	z = float((ind // w**2))
	y = float((ind// w)-w*z)
	x = float(ind % w)


	return [x,y,z]

#def g2i_s(ind):
#	outInd = []
#	z = ind[2]
#	y = ind[1]
#	x = ind[0]
#	outInd = int(x + y*w + z*w**2)
#	return outInd
	
index = []
strG = "GRID*   "
strG1 = "0               "
outputGRID = "\n"
outputG = []

i=1
for b in points:

	x2 = i2g_s(b)[0] 
	y2 = i2g_s(b)[1] 
	z2 = i2g_s(b)[2] 
	
	coord = [x2, y2, z2, i]
	outputG.append(coord)
#	outputT = "{}{:<8}{:<8}{:<8}{:<8} \n".format(strG, g2i_s([x2,y2,z2]), x2 , y2 , z2 )			
	outputT = "{}{:<16}{}{:<16}{:<16}*{:<6}\n*{:<7}{:<16} \n".format(strG, int(b), strG1, x2 , y2 , base36encode(i-1),base36encode(i-1), z2 )
	outputGRID = outputGRID + outputT
	
	i += 1 
	
OUT = outputGRID
# ----------------------------------------
watch_2 = Watch(py_grid_to_index)
loading = StringInput("""
$Static Load Combination (Superposition)                                        
LOAD    1       1.      1.      10000   1.      10001   1.      99999           
        1.      99998   0.      99994   0.      99993      
""")
materials = StringInput("""
$Isotropic Material Property Definition                                         
$Material for Part 1 - Quenched and tempered                                    
MAT1    1       199948.         0.29    7.8547-91.17-5  0.                      
$Heat Transfer Material Properties, Isotropic                                   
$Material for Part 1 - Quenched and tempered                                    
MAT4    1       0.0467590. 
""")
parameters = StringInput("""PARAM,POST,-1
PARAM,OGEOM,NO
PARAM,AUTOSPC,YES
PARAM,GRDPNT,0
$In SimMech, results are in element coordinates (except solids; see VOLUME).    
PARAM,ELEMRSLTCORD,ELEMENT
PARAM,ELEMGEOMCHECKS,OFF



$Properties of Solid Elements                                                   
PSOLID  1       1       0                                                       



""")
code_block_3 = CodeBlock { 0.5; }
py_spc = Python(IN[0]=code_block_2, IN[1]=size_grid, IN[2]=code_block_3)
# ---------- py_spc.python (36 lines) ----------
import clr
import operator
clr.AddReference('ProtoGeometry')
from Autodesk.DesignScript.Geometry import *
#The inputs to this node will be stored as a list in the IN variables.
dataEnteringNode = IN

grid = IN[0]
w = IN[1]
fp = IN[2]

newSPC = ''
strF = "SPC     1       "  
strF1 = "123"
spcList = "\n\n"

list1 = []
	
def i2g_s(itg):

	z = operator.floordiv(itg, w**2) 
	y = operator.floordiv(itg, w)-w*z
	x = itg % w

	return [x,y,z]
	
	
for i, p in enumerate(grid):
	if i2g_s(p)[2] < fp:
		
		list1.append(p)
		newSPC =  "{}{:<8}{} \n".format(strF,str(p),strF1)
		spcList = spcList + newSPC

#Assign your output to the OUT variable.
OUT = spcList
# ----------------------------------------
watch_3 = Watch(py_spc)
constraints = Watch(watch_3)
end_data = StringInput("""                                                  
                                          
TEMPD   3       0.                                                              
ENDDATA

""")
concat = String.Concat(setup, watch, gravity, force, watch_2, loading, materials, parameters, constraints, end_data)
NAS_output = Watch(concat)
string_3 = StringInput("C:\test\Nastrynamo\Voxels\NasWrite\voxel_maker-S3.nas")
writeText = File.WriteText(string_3, concat)
code_block_4 = CodeBlock { Flatten({1..1000}); }
code_block_5 = CodeBlock(n=SIZE) { n-1; n; }
code_block_6 = CodeBlock(X=code_block_5.out0, Nx=code_block_5.n, Y=code_block_5.out0, Ny=code_block_5.n, Z=code_block_5.out0, Nz=code_block_5.n) { 0..(X)..#Nx; 0..(Y)..#Ny; 0..(Z)..#Nz; }
byCoordinates = Point.ByCoordinates(x=code_block_6.out0, y=code_block_6.out1, z=code_block_6.out2, lacing=CrossProduct)
code_block_7 = CodeBlock(point1=byCoordinates)
# ---------- code_block_7.designscript (6 lines) ----------
t2 = Flatten(point1);
point2 = Autodesk.Point.Origin();
vector1 = Vector.YAxis();
geometry1 = t2.Rotate(point2, vector1, 90);
plane1 = Plane.XY();
geometry2 = geometry1.Mirror(plane1);
# ----------------------------------------
points = CodeBlock(p=code_block_7.geometry2) { p; }
watch_4 = Watch(python_script)
